# Grasshopper definition TestDefinition.gh (Grasshopper 1.0.7)
# plug-ins: Component Parameter

list = ValueList({"Input", "Output"}, selected="Output")
list_2 = ValueList({"Item", "List", "Tree"}, selected="Item")
list_3 = ValueList({"Generic", "Curve", "Number", "Plane", "Point", "Text"}, selected="Number")
list_4 = ValueList({"Input", "Output"}, selected="Input")
list_5 = ValueList({"Item", "List", "Tree"}, selected="Item")
list_6 = ValueList({"Generic", "Curve", "Number", "Plane", "Point", "Text"}, selected="Plane")
list_7 = ValueList({"Input", "Output"}, selected="Input")
list_8 = ValueList({"Item", "List", "Tree"}, selected="Item")
list_9 = ValueList({"Generic", "Curve", "Number", "Plane", "Point", "Text"}, selected="Point")
list_10 = ValueList({"Input", "Output"}, selected="Output")
list_11 = ValueList({"Item", "List", "Tree"}, selected="Item")
list_12 = ValueList({"Generic", "Curve", "Number", "Plane", "Point", "Text"}, selected="Number")
list_13 = ValueList({"Input", "Output"}, selected="Input")
list_14 = ValueList({"Item", "List", "Tree"}, selected="Item")
list_15 = ValueList({"Generic", "Curve", "Number", "Plane", "Point", "Text"}, selected="Curve")
cd = CreateComponentData(
    Name="MyNewComponent2",
    Nickname="MNC",
    Description="My second shiny new component.",
    Category="MyCategory",
    SubCategory="NewComponents")
pd = CreateIOParameter(
    Name="Distance",
    Nickname="D",
    Description="Distance of point from plane.",
    Usage=list,
    DataAccess=list_2,
    ParamType=list_3)
pd_2 = CreateIOParameter(Name="Plane", Nickname="P", Description="A plane.", Usage=list_4, DataAccess=list_5, ParamType=list_6)
pd_3 = CreateIOParameter(Name="Point", Nickname="P", Description="A point.", Usage=list_7, DataAccess=list_8, ParamType=list_9)
cd_2 = CreateComponentData(
    Name="MyNewComponent",
    Nickname="MNC",
    Description="My shiny new component.",
    Category="MyCategory",
    SubCategory="NewComponents")
pd_4 = CreateIOParameter(
    Name="Length",
    Nickname="L",
    Description="Length on curve at nearest point.",
    Usage=list_10,
    DataAccess=list_11,
    ParamType=list_12)
pd_5 = CreateIOParameter(Name="Curve", Nickname="C", Description="A curve.", Usage=list_13, DataAccess=list_14, ParamType=list_15)
merge = Merge(Data1=pd, Data2=pd_3, Data3=pd_2)
merge_2 = Merge(Data1=pd_3, Data2=pd_5, Data3=pd_4)
cc = CreateComponentDefinition(ComponentData=cd_2, ParameterData=merge_2)
cc_2 = CreateComponentDefinition(ComponentData=cd, ParameterData=merge)
gc = GenerateComponentCode(OutputDirectory="C:\Users\g.maciocci\Desktop\TestOutputComponentCode", ComponentDefinition=[cc, cc_2], Generate=Button())
